# Grasshopper definition WALL FALTS WITH ONE WINDOW.gh (Grasshopper 1.0.5)

number_slider = Slider(0, range=0..1)

# ---- group: wall flat size
width = Slider(60, range=0..120)
thickness = Slider(4, range=0..10)
height = Slider(120, range=0..120)

# ----
skin_thickness = Slider(0.5, range=0..2)
window_location_x = Slider(22, range=0..100)
window_location_y = Slider(24, range=0..100)
window_size_y = Slider(60, range=0..100)
cover_thickness = Slider(0.5, range=0..1)
toogle_thickness = Slider(0.75, range=0..2)
toogle_distance = Slider(24, range=0..24)
stud_thickness = Slider(0.75, range=0..2)
stud_distance = Slider(24, range=0..24)
framing_tolorrance = Slider(2, range=0..10)
m_t_tolorance = Slider(0.0313, range=0..0.1)
bit_dia = Slider(0.375, range=0..1)
window_size_x = Slider(19, range=0..100)

number_slider_2 = Slider(0, range=0..1)
number_slider_3 = Slider(0, range=0..1)
number_slider_4 = Slider(0, range=0..1)
subtraction = Subtraction(A=window_location_x, B=cover_thickness)
X = UnitX(Factor=stud_thickness)
subtraction_2 = Subtraction(A=window_location_y, B=cover_thickness)
X_2 = UnitX(Factor=subtraction)
subtraction_3 = Subtraction(A=width, B=window_location_x, C=window_size_x)
addition = Addition(A=window_location_x, B=window_size_x, C=cover_thickness, D=stud_thickness)
X_3 = UnitX(Factor=window_location_x)
Z = UnitZ(Factor=subtraction_2)
Y = UnitY(Factor=skin_thickness)

xy = XYPlane(Origin=Point(0, 0, 0))
rectangle = Rectangle(Plane=xy, XSize=width, YSize=thickness, Radius=0)  # -> Rectangle, Length
Z_2 = UnitZ(Factor=height)
extr = Extrude(Base=rectangle.Rectangle, Direction=Z_2)

addition_2 = Addition(A=X_2, B=Z, C=Y)
Y_2 = UnitY(Factor=skin_thickness)
Z_3 = UnitZ(Factor=toogle_thickness)
subtraction_4 = Subtraction(A=width, B=stud_thickness, C=stud_thickness)
subtraction_5 = Subtraction(A=window_location_x, B=cover_thickness, C=stud_thickness, D=stud_thickness)
subtraction_6 = Subtraction(A=subtraction_3, B=cover_thickness, C=stud_thickness, D=stud_thickness)
X_4 = UnitX(Factor=addition)

rectangle_2 = Rectangle(Plane=xy, XSize=width, YSize=skin_thickness, Radius=0)  # -> Rectangle, Length
Z_4 = UnitZ(Factor=height)
subtraction_7 = Subtraction(A=thickness, B=skin_thickness)
extr_2 = Extrude(Base=rectangle_2.Rectangle, Direction=Z_4)
Y_3 = UnitY(Factor=subtraction_7)
move = Move(Geometry=extr_2, Motion=Y_3)  # -> Geometry, Transform
cap = CapHoles(Brep=[extr_2, move.Geometry])  # -> graft(Brep)

xz = XZPlane(Origin=Point(0, 0, 0))
X_5 = UnitX(Factor=window_location_x)
Z_5 = UnitZ(Factor=window_location_y)
addition_3 = Addition(A=X_5, B=Z_5)
move_2 = Move(Geometry=xz, Motion=addition_3)  # -> Geometry, Transform
rectangle_3 = Rectangle(Plane=move_2.Geometry, XSize=window_size_x, YSize=window_size_y, Radius=0)  # -> Rectangle, Length
Y_4 = UnitY(Factor=thickness)
extr_3 = Extrude(Base=rectangle_3.Rectangle, Direction=Y_4)
cap_2 = CapHoles(Brep=extr_3)

addition_4 = Addition(A=X_3, B=Z, C=Y)
move_3 = Move(Geometry=xy, Motion=addition_2)  # -> Geometry, Transform
addition_5 = Addition(A=Y_2, B=Z_3)
move_4 = Move(Geometry=xy, Motion=addition_4)  # -> Geometry, Transform
subtraction_8 = Subtraction(A=thickness, B=skin_thickness, C=skin_thickness)
rectangle_4 = Rectangle(Plane=move_3.Geometry, XSize=cover_thickness, YSize=subtraction_8, Radius=0)  # -> Rectangle, Length
Z_6 = UnitZ(Factor=toogle_thickness)
Z_7 = UnitZ(Factor=toogle_thickness)
Z_8 = UnitZ(Factor=toogle_thickness)
rectangle_5 = Rectangle(Plane=move_4.Geometry, XSize=window_size_x, YSize=subtraction_8, Radius=0)  # -> Rectangle, Length
move_5 = Move(Geometry=xy, Motion=addition_5)  # -> Geometry, Transform
subtraction_9 = Subtraction(A=thickness, B=skin_thickness, C=skin_thickness)
addition_6 = Addition(A=window_size_y, B=cover_thickness, C=cover_thickness)
move_6 = Move(Geometry=xy, Motion=Y_2)  # -> Geometry, Transform
move_7 = Move(Geometry=move_6.Geometry, Motion=X)  # -> Geometry, Transform
rectangle_6 = Rectangle(Plane=move_7.Geometry, XSize=subtraction_4, YSize=subtraction_9, Radius=0)  # -> Rectangle, Length
rectangle_7 = Rectangle(Plane=move_7.Geometry, XSize=subtraction_5, YSize=subtraction_9, Radius=0)  # -> Rectangle, Length
move_8 = Move(Geometry=move_6.Geometry, Motion=X_4)  # -> Geometry, Transform
rectangle_8 = Rectangle(Plane=move_8.Geometry, XSize=subtraction_6, YSize=subtraction_9, Radius=0)  # -> Rectangle, Length
extr_4 = Extrude(Base=rectangle_6.Rectangle, Direction=Z_6)
extr_5 = Extrude(Base=rectangle_7.Rectangle, Direction=Z_7)
extr_6 = Extrude(Base=rectangle_8.Rectangle, Direction=Z_8)
Z_9 = UnitZ(Factor=cover_thickness)
addition_7 = Addition(A=window_size_y, B=cover_thickness)
Z_10 = UnitZ(Factor=addition_6)
addition_8 = Addition(A=window_size_x, B=cover_thickness)
rectangle_9 = Rectangle(Plane=move_5.Geometry, XSize=stud_thickness, YSize=subtraction_9, Radius=0)  # -> Rectangle, Length
cap_3 = CapHoles(Brep=extr_4)
cap_4 = CapHoles(Brep=extr_5)
cap_5 = CapHoles(Brep=extr_6)
Z_11 = UnitZ(Factor=addition_7)
extr_7 = Extrude(Base=rectangle_5.Rectangle, Direction=Z_9)
subtraction_10 = Subtraction(A=window_size_x, B=framing_tolorrance)
extr_8 = Extrude(Base=rectangle_4.Rectangle, Direction=Z_10)
rectangle_10 = Rectangle(Plane=move_6.Geometry, XSize=width, YSize=subtraction_9, Radius=0)  # -> Rectangle, Length
X_6 = UnitX(Factor=addition_8)
addition_9 = Addition(A=subtraction_10)
division = Division(A=addition_9, B=stud_distance)
subtraction_11 = Subtraction(A=window_location_y, B=toogle_thickness, C=toogle_thickness, D=cover_thickness)
addition_10 = Addition(A=window_location_y, B=window_size_y, C=cover_thickness)
subtraction_12 = Subtraction(A=height, B=addition_10, C=toogle_thickness, D=toogle_thickness)
split = TextSplit(Text=division, Separators=".")
Z_12 = UnitZ(Factor=addition_10)
subtraction_13 = Subtraction(A=height, B=toogle_thickness, C=toogle_thickness)
item = ListItem(List=split, Index=0, Wrap=True)
Z_13 = UnitZ(Factor=subtraction_11)
Z_14 = UnitZ(Factor=subtraction_12)
subtraction_14 = Subtraction(A=window_location_x, B=stud_thickness, C=cover_thickness)
subtraction_15 = Subtraction(A=subtraction_14, B=framing_tolorrance)
division_2 = Division(A=subtraction_15, B=stud_distance)
split_2 = TextSplit(Text=division_2, Separators=".")
item_2 = ListItem(List=split_2, Index=0, Wrap=True)
addition_11 = Addition(A=window_location_x, B=window_size_x, C=cover_thickness)
subtraction_16 = Subtraction(A=width, B=stud_thickness)
subtraction_17 = Subtraction(A=subtraction_16, B=addition_11, C=framing_tolorrance)
addition_12 = Addition(A=subtraction_17)
division_3 = Division(A=subtraction_17, B=stud_distance)
split_3 = TextSplit(Text=division_3, Separators=".")
item_3 = ListItem(List=split_3, Index=0, Wrap=True)
series = Series(Start=stud_distance, Step=stud_distance, Count=item_3)
Z_15 = UnitZ(Factor=subtraction_13)
Z_16 = UnitZ(Factor=toogle_thickness)
subtraction_18 = Subtraction(A=window_location_y, B=toogle_thickness, C=cover_thickness)
subtraction_19 = Subtraction(A=subtraction_18, B=framing_tolorrance)
division_4 = Division(A=subtraction_19, B=toogle_distance)
split_4 = TextSplit(Text=division_4, Separators=".")
item_4 = ListItem(List=split_4, Index=0, Wrap=True)
addition_13 = Addition(A=subtraction_18, B=toogle_distance)
series_2 = Series(Start=toogle_distance, Step=toogle_distance, Count=item_4)
addition_14 = Addition(A=window_location_y, B=window_size_y, C=cover_thickness)
subtraction_20 = Subtraction(A=height, B=addition_14, C=toogle_thickness, D=framing_tolorrance)
division_5 = Division(A=subtraction_20, B=toogle_distance)
subtraction_21 = Subtraction(A=addition_14, B=subtraction_18, C=framing_tolorrance)
split_5 = TextSplit(Text=division_5, Separators=".")
division_6 = Division(A=subtraction_21, B=toogle_distance)
item_5 = ListItem(List=split_5, Index=0, Wrap=True)
split_6 = TextSplit(Text=division_6, Separators=".")
addition_15 = Addition(A=addition_14, B=toogle_distance)
item_6 = ListItem(List=split_6, Index=0, Wrap=True)
series_3 = Series(Start=addition_15, Step=toogle_distance, Count=item_5)
subtraction_22 = Subtraction(A=height, B=toogle_thickness)
series_4 = Series(Start=stud_distance, Step=stud_distance, Count=item)
series_5 = Series(Start=stud_distance, Step=stud_distance, Count=item_2)
series_6 = Series(Start=addition_13, Step=toogle_distance, Count=item_6)
X_7 = UnitX(Factor=series_4)
extr_9 = Extrude(Base=rectangle_9.Rectangle, Direction=Z_15)
X_8 = UnitX(Factor=subtraction_14)
move_9 = Move(Geometry=rectangle_9.Rectangle, Motion=X_8)  # -> Geometry, Transform
move_10 = Move(Geometry=move_9.Geometry, Motion=Z_12)  # -> Geometry, Transform
extr_10 = Extrude(Base=move_9.Geometry, Direction=Z_13)
extr_11 = Extrude(Base=move_10.Geometry, Direction=Z_14)
cap_6 = CapHoles(Brep=[extr_10, extr_11])  # -> graft(Brep)
X_9 = UnitX(Factor=addition_11)
X_10 = UnitX(Factor=series)
X_11 = UnitX(Factor=subtraction_16)
extr_12 = Extrude(Base=rectangle_10.Rectangle, Direction=Z_16)
Z_17 = UnitZ(Factor=series_2)
Z_18 = UnitZ(Factor=subtraction_18)
Z_19 = UnitZ(Factor=addition_14)
Z_20 = UnitZ(Factor=series_3)
Z_21 = UnitZ(Factor=subtraction_22)
X_12 = UnitX(Factor=series_5)
Z_22 = UnitZ(Factor=series_6)

# ---- group: SKIN
sdiff = SolidDifference(BrepsA=cap, BrepsB=cap_2)

# ----
move_11 = Move(Geometry=graft([cap_4, cap_5]), Motion=Z_22)  # -> Geometry, Transform
addition_16 = Addition(A=X_9, B=X_10)
move_12 = Move(Geometry=cap_6, Motion=X_7)  # -> Geometry, Transform
move_13 = Move(Geometry=cap_3, Motion=Z_18)  # -> Geometry, Transform
move_14 = Move(Geometry=cap_3, Motion=Z_19)  # -> Geometry, Transform
move_15 = Move(Geometry=cap_3, Motion=Z_20)  # -> Geometry, Transform
addition_17 = Addition(A=X_8, B=X_7)
move_16 = Move(Geometry=cap_3, Motion=Z_17)  # -> Geometry, Transform

# ---- group: MDF COVER
cap_7 = CapHoles(Brep=extr_7)
move_17 = Move(Geometry=cap_7, Motion=Z_11)  # -> Geometry, Transform
cap_8 = CapHoles(Brep=extr_8)
move_18 = Move(Geometry=cap_8, Motion=X_6)  # -> Geometry, Transform

# ----
panel = Panel(X_12)
panel_2 = Panel(X_8)
panel_3 = Panel(addition_17)
panel_4 = Panel(X_9)
panel_5 = Panel(addition_16)

geo = Geometry([cap_7, move_17.Geometry, cap_8, move_18.Geometry])

panel_6 = Panel(Z_17)
panel_7 = Panel(Z_18)
panel_8 = Panel(Z_22)
panel_9 = Panel(Z_19)
panel_10 = Panel(Z_20)

expression = Expression(x=thickness, y=m_t_tolorance, Expression="X/2+Y")
expression_2 = Expression(x=thickness, y=m_t_tolorance, Expression="X/2+Y")
addition_18 = Addition(A=stud_thickness, B=m_t_tolorance)
pt = ConstructPoint(XCoordinate=expr("-X", m_t_tolorance), YCoordinate=expression, ZCoordinate=0)
pt_2 = ConstructPoint(XCoordinate=addition_18, YCoordinate=expression_2, ZCoordinate=0)
cir = Circle(Plane=pt_2, Radius=expr("X/2", bit_dia))
cir_2 = Circle(Plane=pt, Radius=expr("X/2", bit_dia))
sqrt = SquareRoot(Value=2)
division_7 = Division(A=bit_dia, B=sqrt)
division_8 = Division(A=division_7, B=2)
X_13 = UnitX(Factor=expr("-X", division_8))
Y_5 = UnitY(Factor=expr("-X", division_8))
Y_6 = UnitY(Factor=expr("-X", division_8))
X_14 = UnitX(Factor=division_8)
addition_19 = Addition(A=X_13, B=Y_5)
addition_20 = Addition(A=X_14, B=Y_6)
move_19 = Move(Geometry=cir, Motion=addition_19)  # -> Geometry, Transform
move_20 = Move(Geometry=cir_2, Motion=addition_20)  # -> Geometry, Transform
extr_13 = Extrude(Base=[move_19.Geometry, move_20.Geometry], Direction=Z_16)
cap_9 = CapHoles(Brep=extr_13)  # -> graft(Brep)

addition_21 = Addition(A=toogle_thickness, B=m_t_tolorance)
pt_3 = ConstructPoint(XCoordinate=0, YCoordinate=expr("X/2", thickness), ZCoordinate=addition_21)
pt_4 = ConstructPoint(XCoordinate=0, YCoordinate=expr("X-2", thickness), ZCoordinate=expr("-X", m_t_tolorance))
yz = YZPlane(Origin=pt_3)
yz_2 = YZPlane(Origin=pt_4)
cir_3 = Circle(Plane=yz, Radius=expr("X/2", bit_dia))
cir_4 = Circle(Plane=yz_2, Radius=expr("X/2", bit_dia))
sqrt_2 = SquareRoot(Value=2)
division_9 = Division(A=bit_dia, B=sqrt_2)
division_10 = Division(A=division_9, B=2)
Z_23 = UnitZ(Factor=expr("-X", division_10))
Y_7 = UnitY(Factor=division_10)
Y_8 = UnitY(Factor=division_10)
Z_24 = UnitZ(Factor=division_10)
addition_22 = Addition(A=Z_23, B=Y_7)
addition_23 = Addition(A=Z_24, B=Y_8)
move_21 = Move(Geometry=cir_3, Motion=addition_22)  # -> Geometry, Transform
move_22 = Move(Geometry=cir_4, Motion=addition_23)  # -> Geometry, Transform
X_15 = UnitX(Factor=stud_thickness)
extr_14 = Extrude(Base=[move_21.Geometry, move_22.Geometry], Direction=X_15)
cap_10 = CapHoles(Brep=extr_14)  # -> graft(Brep)

X_16 = UnitX(Factor=[X_12, X_8, addition_17, X_9, addition_16])  # -> graft(UnitVector)
X_17 = UnitX(Factor=[X_12, X_8, X_9, addition_16])  # -> graft(UnitVector)
X_18 = UnitX(Factor=[X_12, addition_16])  # -> graft(UnitVector)

Z_25 = UnitZ(Factor=[Z_17, Z_18, Z_19, Z_20, Z_22])  # -> flatten(UnitVector)
Z_26 = UnitZ(Factor=[Z_17, Z_18, Z_19, Z_20])  # -> flatten(UnitVector)
Z_27 = UnitZ(Factor=[Z_17, Z_20])  # -> flatten(UnitVector)

division_11 = Division(A=subtraction_9, B=2)
Y_9 = UnitY(Factor=skin_thickness)
rectangle_11 = Rectangle(Plane=Y_9, XSize=stud_thickness, YSize=division_11, Radius=0)  # -> Rectangle, Length
offset = OffsetCurve(Curve=rectangle_11.Rectangle, Distance=m_t_tolorance, Plane=PlaneXY(0, 0, 0), Corners=1)
extr_15 = Extrude(Base=offset, Direction=Z_16)
cap_11 = CapHoles(Brep=extr_15)

Y_10 = UnitY(Factor=expr("x/2", thickness))
Z_28 = UnitZ(Factor=expr("-x", m_t_tolorance))
addition_24 = Addition(A=Y_10, B=Z_28)
move_23 = Move(Geometry=xy, Motion=addition_24)  # -> Geometry, Transform
addition_25 = Addition(A=toogle_thickness, B=m_t_tolorance)
rectangle_12 = Rectangle(Plane=move_23.Geometry, XSize=stud_thickness, YSize=division_11, Radius=0)  # -> Rectangle, Length
addition_26 = Addition(A=addition_25, B=m_t_tolorance)
Z_29 = UnitZ(Factor=addition_26)
extr_16 = Extrude(Base=rectangle_12.Rectangle, Direction=Z_29)
cap_12 = CapHoles(Brep=extr_16)

sunion = SolidUnion(Breps=flatten([cap_11, cap_9]))
sunion_2 = SolidUnion(Breps=flatten([cap_10, cap_12]))

move_24 = Move(Geometry=sunion, Motion=Z_17)  # -> graft(Geometry), Transform
move_25 = Move(Geometry=move_24.Geometry, Motion=X_16)  # -> flatten(Geometry), Transform

move_26 = Move(Geometry=sunion, Motion=Z_18)  # -> Geometry, Transform
move_27 = Move(Geometry=move_26.Geometry, Motion=X_17)  # -> flatten(Geometry), Transform

move_28 = Move(Geometry=sunion, Motion=Z_22)  # -> flatten(Geometry), Transform
move_29 = Move(Geometry=move_28.Geometry, Motion=X_18)  # -> flatten(Geometry), Transform

move_30 = Move(Geometry=sunion, Motion=Z_19)  # -> Geometry, Transform
move_31 = Move(Geometry=move_30.Geometry, Motion=X_17)  # -> flatten(Geometry), Transform

move_32 = Move(Geometry=sunion, Motion=Z_20)  # -> Geometry, Transform
move_33 = Move(Geometry=move_32.Geometry, Motion=X_16)  # -> flatten(Geometry), Transform

move_34 = Move(Geometry=sunion_2, Motion=Z_27)  # -> flatten(Geometry), Transform
addition_27 = Addition(A=X_8, B=X_7)  # -> graft(Result)
move_35 = Move(Geometry=move_34.Geometry, Motion=addition_27)  # -> flatten(Geometry), Transform

move_36 = Move(Geometry=sunion_2, Motion=Z_26)  # -> Geometry, Transform
move_37 = Move(Geometry=move_36.Geometry, Motion=X_8)  # -> flatten(Geometry), Transform

move_38 = Move(Geometry=sunion_2, Motion=Z_25)  # -> Geometry, Transform
move_39 = Move(Geometry=move_38.Geometry, Motion=X_12)  # -> flatten(Geometry), Transform

addition_28 = Addition(A=X_9, B=X_10)  # -> graft(Result)
move_40 = Move(Geometry=move_38.Geometry, Motion=addition_28)  # -> flatten(Geometry), Transform

move_41 = Move(Geometry=move_36.Geometry, Motion=X_9)  # -> flatten(Geometry), Transform

sunion_3 = SolidUnion(Breps=move_39.Geometry)
box = Box({Plane=PlaneXY(-121.9055013, -37.94247498, 0), X=Domain(0, 20.51789749), Y=Domain(0, 22.1453907), Z=Domain(0, 21.80249652)})
sunion_4 = SolidUnion(Breps=[box, move_40.Geometry])
sunion_5 = SolidUnion(Breps=[box, move_37.Geometry])
sunion_6 = SolidUnion(Breps=[box, move_35.Geometry])
sunion_7 = SolidUnion(Breps=[box, move_41.Geometry])
sunion_8 = SolidUnion(Breps=[box, move_25.Geometry])
sunion_9 = SolidUnion(Breps=[box, move_27.Geometry])
sunion_10 = SolidUnion(Breps=[move_29.Geometry, box])
sunion_11 = SolidUnion(Breps=[box, move_31.Geometry])
sunion_12 = SolidUnion(Breps=[box, move_33.Geometry])

# ---- group: TOOGLE
cap_13 = CapHoles(Brep=extr_12)
sdiff_2 = SolidDifference(BrepsA=move_16.Geometry, BrepsB=sunion_8)
sdiff_3 = SolidDifference(BrepsA=move_13.Geometry, BrepsB=sunion_9)
sdiff_4 = SolidDifference(BrepsA=move_11.Geometry, BrepsB=sunion_10)
sdiff_5 = SolidDifference(BrepsA=move_14.Geometry, BrepsB=sunion_11)
sdiff_6 = SolidDifference(BrepsA=move_15.Geometry, BrepsB=sunion_12)
move_42 = Move(Geometry=cap_13, Motion=Z_21)  # -> Geometry, Transform

# ----
geo_2 = Geometry([cap_13, sdiff_2, sdiff_3, sdiff_4, sdiff_5, sdiff_6, move_42.Geometry])
preview = CustomPreview(Geometry=sdiff, Material=ColourSwatch(SwatchColor=RGBA(255, 140, 0, 112)))
preview_2 = CustomPreview(Geometry=geo_2, Material=ColourSwatch(SwatchColor=RGBA(90, 156, 73, 137)))
preview_3 = CustomPreview(Geometry=geo, Material=ColourSwatch(SwatchColor=RGBA(90, 156, 73, 137)))

# ---- group: STUD
cap_14 = CapHoles(Brep=extr_9)
sdiff_7 = SolidDifference(BrepsA=move_12.Geometry, BrepsB=sunion_6)
move_43 = Move(Geometry=cap_14, Motion=X_11)  # -> Geometry, Transform

# ----
move_44 = Move(Geometry=cap_14, Motion=X_12)  # -> Geometry, Transform
move_45 = Move(Geometry=cap_14, Motion=X_8)  # -> Geometry, Transform
move_46 = Move(Geometry=cap_14, Motion=X_9)  # -> Geometry, Transform
move_47 = Move(Geometry=move_46.Geometry, Motion=X_10)  # -> Geometry, Transform

# ---- group: STUD (continued)
sdiff_8 = SolidDifference(BrepsA=move_44.Geometry, BrepsB=sunion_3)
sdiff_9 = SolidDifference(BrepsA=move_45.Geometry, BrepsB=sunion_5)
sdiff_10 = SolidDifference(BrepsA=move_46.Geometry, BrepsB=sunion_7)
sdiff_11 = SolidDifference(BrepsA=move_47.Geometry, BrepsB=sunion_4)

# ----
geo_3 = Geometry([cap_14, sdiff_8, sdiff_9, sdiff_7, sdiff_10, sdiff_11, move_43.Geometry])
preview_4 = CustomPreview(Geometry=geo_3, Material=ColourSwatch(SwatchColor=RGBA(170, 255, 0, 150)))
