# Grasshopper definition WALL FALTS.gh (Grasshopper 1.0.5)

m_t_tolorance = Slider(0.015, range=0..0.1)
bit_dia = Slider(0.375, range=0..1)
skin_thickness = Slider(0.5, range=0..2)
toogle_thickness = Slider(0.71, range=0..2)
toogle_distance = Slider(24, range=0..24)
framing_tolorrance = Slider(2, range=0..10)
stud_thickness = Slider(0.71, range=0..2)
stud_distance = Slider(24, range=0..24)

# ---- group: wall flat size
width = Slider(60, range=0..60)
thickness = Slider(4, range=0..10)
height = Slider(120, range=0..120)

# ----
xy = XYPlane(Origin=Point(0, 0, 0))
rectangle = Rectangle(Plane=xy, XSize=width, YSize=thickness, Radius=0)  # -> Rectangle, Length
Z = UnitZ(Factor=height)
extr = Extrude(Base=rectangle.Rectangle, Direction=Z)

rectangle_2 = Rectangle(Plane=xy, XSize=width, YSize=skin_thickness, Radius=0)  # -> Rectangle, Length
subtraction = Subtraction(A=thickness, B=skin_thickness)
Z_2 = UnitZ(Factor=height)
Y = UnitY(Factor=subtraction)
extr_2 = Extrude(Base=rectangle_2.Rectangle, Direction=Z_2)
move = Move(Geometry=extr_2, Motion=Y)  # -> Geometry, Transform
cap = CapHoles(Brep=[extr_2, move.Geometry])

expression = Expression(x=height, y=toogle_thickness, z=framing_tolorrance, d=toogle_distance, Expression="(x-y-z)/d")
Y_2 = UnitY(Factor=skin_thickness)
move_2 = Move(Geometry=xy, Motion=Y_2)  # -> Geometry, Transform
subtraction_2 = Subtraction(A=subtraction, B=skin_thickness)
split = TextSplit(Text=expression, Separators=".")
rectangle_3 = Rectangle(Plane=move_2.Geometry, XSize=width, YSize=subtraction_2, Radius=0)  # -> Rectangle, Length
subtraction_3 = Subtraction(A=height, B=toogle_thickness)
item = ListItem(List=split, Index=Slider(0, range=0..100), Wrap=True)
series = Series(Start=0, Step=toogle_distance, Count=expr("x+1", item))
Z_3 = UnitZ(Factor=subtraction_3)
Z_4 = UnitZ(Factor=toogle_thickness)
Z_5 = UnitZ(Factor=series)
extr_3 = Extrude(Base=rectangle_3.Rectangle, Direction=Z_4)
move_3 = Move(Geometry=extr_3, Motion=Z_5)  # -> Geometry, Transform
move_4 = Move(Geometry=extr_3, Motion=Z_3)  # -> Geometry, Transform
cap_2 = CapHoles(Brep=move_3.Geometry)
cap_3 = CapHoles(Brep=move_4.Geometry)
split_2 = SplitList(List=cap_2, Index=1)  # -> ListA, ListB

expression_2 = Expression(x=thickness, y=m_t_tolorance, Expression="X/2+Y")
expression_3 = Expression(x=thickness, y=m_t_tolorance, Expression="X/2+Y")
addition = Addition(A=stud_thickness, B=m_t_tolorance)
pt = ConstructPoint(XCoordinate=expr("-X", m_t_tolorance), YCoordinate=expression_2, ZCoordinate=0)
pt_2 = ConstructPoint(XCoordinate=addition, YCoordinate=expression_3, ZCoordinate=0)
cir = Circle(Plane=pt_2, Radius=expr("X/2", bit_dia))
cir_2 = Circle(Plane=pt, Radius=expr("X/2", bit_dia))
sqrt = SquareRoot(Value=2)
division = Division(A=bit_dia, B=sqrt)
division_2 = Division(A=division, B=2)
X = UnitX(Factor=expr("-X", division_2))
Y_3 = UnitY(Factor=expr("-X", division_2))
Y_4 = UnitY(Factor=expr("-X", division_2))
X_2 = UnitX(Factor=division_2)
addition_2 = Addition(A=X, B=Y_3)
addition_3 = Addition(A=X_2, B=Y_4)
move_5 = Move(Geometry=cir, Motion=addition_2)  # -> Geometry, Transform
move_6 = Move(Geometry=cir_2, Motion=addition_3)  # -> Geometry, Transform
extr_4 = Extrude(Base=[move_5.Geometry, move_6.Geometry], Direction=Z_4)
cap_4 = CapHoles(Brep=extr_4)  # -> flatten(Brep)

# ---- group: STUD
Y_5 = UnitY(Factor=skin_thickness)
Z_6 = UnitZ(Factor=toogle_thickness)
expression_4 = Expression(x=width, y=stud_thickness, z=framing_tolorrance, d=stud_distance, Expression="(x-y-z)/d")
addition_4 = Addition(A=Y_5, B=Z_6)
move_7 = Move(Geometry=xy, Motion=addition_4)  # -> Geometry, Transform
subtraction_4 = Subtraction(A=subtraction, B=skin_thickness)
subtraction_5 = Subtraction(A=height, B=toogle_thickness)
split_3 = TextSplit(Text=expression_4, Separators=".")
rectangle_4 = Rectangle(Plane=move_7.Geometry, XSize=stud_thickness, YSize=subtraction_4, Radius=0)  # -> Rectangle, Length
subtraction_6 = Subtraction(A=subtraction_5, B=toogle_thickness)
subtraction_7 = Subtraction(A=width, B=stud_thickness)
item_2 = ListItem(List=split_3, Index=Slider(0, range=0..100), Wrap=True)
Z_7 = UnitZ(Factor=subtraction_6)
series_2 = Series(Start=0, Step=stud_distance, Count=expr("x+1", item_2))
extr_5 = Extrude(Base=rectangle_4.Rectangle, Direction=Z_7)
X_3 = UnitX(Factor=subtraction_7)
X_4 = UnitX(Factor=series_2)
move_8 = Move(Geometry=extr_5, Motion=X_4)  # -> Geometry, Transform
move_9 = Move(Geometry=extr_5, Motion=X_3)  # -> Geometry, Transform
cap_5 = CapHoles(Brep=move_9.Geometry)
cap_6 = CapHoles(Brep=move_8.Geometry)

# ----
split_4 = SplitList(List=cap_6, Index=1)  # -> ListA, ListB
skin = Geometry(cap)
preview = CustomPreview(Geometry=skin, Material=ColourSwatch(SwatchColor=RGBA(255, 140, 0, 112)))

Y_6 = UnitY(Factor=expr("x/2", thickness))
Z_8 = UnitZ(Factor=expr("-x", m_t_tolorance))
addition_5 = Addition(A=Y_6, B=Z_8)
move_10 = Move(Geometry=xy, Motion=addition_5)  # -> Geometry, Transform
addition_6 = Addition(A=toogle_thickness, B=m_t_tolorance)
addition_7 = Addition(A=addition_6, B=m_t_tolorance)
Z_9 = UnitZ(Factor=addition_7)
series_3 = Series(Start=stud_distance, Step=stud_distance, Count=item_2)
X_5 = UnitX(Factor=series_3)
series_4 = Series(Start=toogle_distance, Step=toogle_distance, Count=item)
Z_10 = UnitZ(Factor=series_4)
box = Box({Plane=PlaneXY(-52.42977972, -46.74092439, 0), X=Domain(0, 14.41352709), Y=Domain(0, 12.52757252), Z=Domain(0, 8.393959015)})

addition_8 = Addition(A=toogle_thickness, B=m_t_tolorance)
pt_3 = ConstructPoint(XCoordinate=0, YCoordinate=Y_6, ZCoordinate=expr("-X", m_t_tolorance))
pt_4 = ConstructPoint(XCoordinate=0, YCoordinate=Y_6, ZCoordinate=addition_8)
yz = YZPlane(Origin=pt_4)
yz_2 = YZPlane(Origin=pt_3)
cir_3 = Circle(Plane=yz, Radius=expr("X/2", bit_dia))
cir_4 = Circle(Plane=yz_2, Radius=expr("X/2", bit_dia))
sqrt_2 = SquareRoot(Value=2)
division_3 = Division(A=bit_dia, B=sqrt_2)
division_4 = Division(A=division_3, B=2)
Z_11 = UnitZ(Factor=expr("-X", division_4))
Y_7 = UnitY(Factor=division_4)
Y_8 = UnitY(Factor=division_4)
Z_12 = UnitZ(Factor=division_4)
addition_9 = Addition(A=Z_11, B=Y_7)
addition_10 = Addition(A=Z_12, B=Y_8)
move_11 = Move(Geometry=cir_3, Motion=addition_9)  # -> Geometry, Transform
move_12 = Move(Geometry=cir_4, Motion=addition_10)  # -> Geometry, Transform
X_6 = UnitX(Factor=stud_thickness)
extr_6 = Extrude(Base=[move_11.Geometry, move_12.Geometry], Direction=X_6)
cap_7 = CapHoles(Brep=extr_6)  # -> graft(Brep)

division_5 = Division(A=subtraction_2, B=2)
rectangle_5 = Rectangle(Plane=move_2.Geometry, XSize=stud_thickness, YSize=division_5, Radius=0)  # -> Rectangle, Length
offset = OffsetCurve(Curve=rectangle_5.Rectangle, Distance=m_t_tolorance, Plane=PlaneXY(0, 0, 0), Corners=1)
extr_7 = Extrude(Base=offset, Direction=Z_4)
cap_8 = CapHoles(Brep=extr_7)
series_5 = Series(Start=stud_distance, Step=stud_distance, Count=item_2)
X_7 = UnitX(Factor=series_5)
series_6 = Series(Start=toogle_distance, Step=toogle_distance, Count=item)
Z_13 = UnitZ(Factor=series_6)
box_2 = Box({Plane=PlaneXY(-52.42977972, -46.74092439, 0), X=Domain(0, 14.41352709), Y=Domain(0, 12.52757252), Z=Domain(0, 8.393959015)})

rectangle_6 = Rectangle(Plane=move_10.Geometry, XSize=stud_thickness, YSize=division_5, Radius=0)  # -> Rectangle, Length
extr_8 = Extrude(Base=rectangle_6.Rectangle, Direction=Z_9)
cap_9 = CapHoles(Brep=extr_8)
move_13 = Move(Geometry=[cap_9, cap_7], Motion=X_5)  # -> graft(Geometry), Transform
move_14 = Move(Geometry=move_13.Geometry, Motion=Z_10)  # -> flatten(Geometry), Transform
sunion = SolidUnion(Breps=[move_14.Geometry, box])
sdiff = SolidDifference(BrepsA=split_4.ListB, BrepsB=sunion)

sunion_2 = SolidUnion(Breps=flatten([cap_4, cap_8]))

move_15 = Move(Geometry=sunion_2, Motion=X_7)  # -> flatten(Geometry), Transform
move_16 = Move(Geometry=move_15.Geometry, Motion=graft(Z_13))  # -> flatten(Geometry), Transform
sunion_3 = SolidUnion(Breps=[move_16.Geometry, box_2])
sdiff_2 = SolidDifference(BrepsA=split_2.ListB, BrepsB=sunion_3)

# ---- group: STUD
geo = Geometry(flatten([split_4.ListA, sdiff, cap_5]))

# ----
sdiff_3 = SolidDifference(BrepsA=[split_2.ListA, sdiff_2, cap_3], BrepsB=geo)

# ---- group: TOOGEL
geo_2 = Geometry(flatten(sdiff_3))

# ----
preview_2 = CustomPreview(Geometry=geo_2, Material=ColourSwatch(SwatchColor=RGBA(170, 255, 0, 150)))
preview_3 = CustomPreview(Geometry=geo, Material=ColourSwatch(SwatchColor=RGBA(90, 156, 73, 137)))
